# Grasshopper definition S-AlyMahmoud-CurtainsDrop.gh (Grasshopper 1.0.7)

geometry = Geometry(<brep referenced from the Rhino model>)
geometry_2 = Geometry([<brep referenced from the Rhino model> x2])
brep_brep = BrepBrep(BrepA=geometry_2, BrepB=geometry)  # -> Curves, Points
width = GetNumber(Slider(16.33, range=1..20), AtLeast=1, AtMost=1, Maximum=1.797693135e+308, Minimum=-1.797693135e+308, TreeAccess=False)
height = GetNumber(Slider(9.26, range=1..20), AtLeast=1, AtMost=1, Maximum=1.797693135e+308, Minimum=-1.797693135e+308, TreeAccess=False)
xz_plane = XZPlane(Origin=Point(0, 0, 0))
rectangle = Rectangle(Plane=xz_plane, XSize=width, YSize=height, Radius=0)  # -> Rectangle, Length
explode = Explode(Curve=rectangle.Rectangle, Recursive=True)  # -> Segments, Vertices
polygon_center = PolygonCenter(Polyline=rectangle.Rectangle)  # -> CenterV, CenterE, CenterA
value_list = ValueList({"XY": 0, "XZ": 1, "YZ": 2}, selected="XZ")
xy_plane = XYPlane(Origin=Point(0, 0, 0))
xz_plane_2 = XZPlane(Origin=Point(0, 0, 0))
yz_plane = YZPlane(Origin=Point(0, 0, 0))
explode_2 = Explode(Curve=brep_brep.Curves, Recursive=True)  # -> Segments, Vertices
list_item = ListItem(List=explode.Segments, Index=0, Wrap=True)  # -> Item1, Item, Item1_2, Item2
evaluate_surface = EvaluateSurface(Surface=rectangle.Rectangle, Point=polygon_center.CenterV)  # -> Point, Normal, UDirection, VDirection, Frame
curve = Curve(list_item.Item)
list_item_2 = ListItem(List=[xy_plane, xz_plane_2, yz_plane], Index=value_list, Wrap=True)
curve_2 = Curve(list_item.Item1_2)
plane_surface = PlaneSurface(Plane=evaluate_surface.Frame, XSize=Domain(-10, 10), YSize=Domain(-10, 10))

deconstruct_vector = DeconstructVector(Vector=explode.Segments)  # -> XComponent, YComponent, ZComponent
cull_pattern = CullPattern(List=explode.Segments, CullPattern=deconstruct_vector.ZComponent)
length = Length(Curve=curve)
horizontal_panels_number = GetInteger(Slider(4, range=1..20), AtLeast=1, AtMost=1, Maximum=2147483647, Minimum=-2147483648, TreeAccess=False)
cull_pattern_2 = CullPattern(List=explode.Segments, CullPattern=deconstruct_vector.XComponent)
list_item_3 = ListItem(List=cull_pattern, Index=0, Wrap=True)  # -> Item, Item1
vertical_panels_number = GetInteger(Slider(4, range=1..20), AtLeast=1, AtMost=1, Maximum=2147483647, Minimum=-2147483648, TreeAccess=False)
length_2 = Length(Curve=curve_2)
division = Division(A=length, B=horizontal_panels_number)
list_item_4 = ListItem(List=cull_pattern_2, Index=0, Wrap=True)  # -> Item, Item1
flip_curve = FlipCurve(Curve=list_item_3.Item)  # -> Curve, Flag
division_2 = Division(A=length_2, B=vertical_panels_number)
flip_curve_2 = FlipCurve(Curve=list_item_4.Item, Guide=list_item_4.Item1)  # -> Curve, Flag
length_3 = Length(Curve=flip_curve_2.Curve)
divide_length = DivideLength(Curve=flip_curve_2.Curve, Length=division)  # -> Points, Tangents, Parameters
divide_length_2 = DivideLength(Curve=list_item_4.Item1, Length=division)  # -> Points, Tangents, Parameters
divide_length_3 = DivideLength(Curve=list_item_3.Item1, Length=division_2)  # -> Points, Tangents, Parameters
divide_length_4 = DivideLength(Curve=flip_curve.Curve, Length=division_2)  # -> Points, Tangents, Parameters
line = Line(StartPoint=divide_length.Points, EndPoint=divide_length_2.Points)
line_2 = Line(StartPoint=divide_length_4.Points, EndPoint=divide_length_3.Points)

geometry_3 = Geometry(<brep referenced from the Rhino model>)
orient = Orient(Geometry=rectangle.Rectangle, Source=plane_surface, Target=list_item_2)  # -> Geometry, Transform
curve_3 = Curve(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)
transform = Transform(Geometry=curve_3, Transform=orient.Transform)
length_4 = Length(Curve=list_item.Item1_2)
length_5 = Length(Curve=list_item.Item)
vector_2pt = Vector2Pt(PointA=divide_length_4.Points, PointB=divide_length_3.Points, Unitize=False)  # -> Vector, Length

curve_4 = Curve(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)
rotate_axis = RotateAxis(Geometry=curve_4, Angle=1.570796327, Axis=Line((0.025, 0, 0), (0.025, -0.16, 0)))  # -> Geometry, Transform
orient_2 = Orient(Geometry=rotate_axis.Geometry, Source=PlaneXY(0, 0, 0), Target=divide_length_4.Points)  # -> Geometry, Transform

curve_5 = Curve(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)
orient_3 = Orient(Geometry=graft(curve_5), Source=PlaneXY(0, 0, 0), Target=divide_length.Points)  # -> flatten(Geometry), Transform

addition = Addition(A=vector_2pt.Length, B=0.05)

addition_2 = Addition(A=length_5, B=0.05)
negative = Negative(Value=addition_2)
boundary_surfaces = BoundarySurfaces(Edges=flatten(orient_2.Geometry))
unit_x = UnitX(Factor=negative)

fixing_height = GetNumber(Slider(2, range=2..15), AtLeast=1, AtMost=1, Maximum=1.797693135e+308, Minimum=-1.797693135e+308, TreeAccess=False)

unit_z = UnitZ(Factor=length_4)
boundary_surfaces_2 = BoundarySurfaces(Edges=orient_3.Geometry)

line_sdl = LineSDL(Start=divide_length_4.Points, Direction=vector_2pt.Vector, Length=addition)
boundary_surfaces_3 = BoundarySurfaces(Edges=rectangle.Rectangle)
polygon_center_2 = PolygonCenter(Polyline=boundary_surfaces_3)  # -> CenterV, CenterE, CenterA
extrude_along = ExtrudeAlong(Base=boundary_surfaces_2, Curve=line)
unit_y = UnitY(Factor=Slider(-0.12, range=-0.12..1))
extrude_along_2 = ExtrudeAlong(Base=boundary_surfaces, Curve=line_sdl)
scale = Scale(Geometry=boundary_surfaces_3, Center=polygon_center_2.CenterV, Factor="1.002")  # -> Geometry, Transform
move = Move(Geometry=scale.Geometry, Motion=unit_y)  # -> Geometry, Transform
bounding_box = BoundingBox(Content=[extrude_along, extrude_along_2], Plane=PlaneXY(0, 0, 0), UnionBox=False)  # -> Box, Box_2
solid_union = SolidUnion(Breps=flatten(bounding_box.Box))

custom_preview = CustomPreview(Geometry=[extrude_along_2, extrude_along], Material=ColourSwatch(SwatchColor=RGB(54, 54, 54)))

brep_brep_2 = BrepBrep(BrepA=flatten(solid_union), BrepB=move.Geometry)  # -> Curves, Points
offset_curve = OffsetCurve(Curve=brep_brep_2.Curves, Distance=Slider(0.016, range=0..0.1), Corners=1)
negative_2 = Negative(Value=Slider(0.06, range=0..1))
boundary_surfaces_4 = BoundarySurfaces(Edges=flatten(offset_curve))
list_item_5 = ListItem(List=boundary_surfaces_4, Index=0, Wrap=True)
unit_y_2 = UnitY(Factor=negative_2)
list_length = ListLength(List=boundary_surfaces_4)
area = Area(Geometry=list_item_5)  # -> Area, Centroid
multiplication = Multiplication(A=Slider(2.25, range=0..10), B=Slider(3.2, range=0..10))
dimensions = Dimensions(Surface=list_item_5)  # -> UDimension, VDimension
move_2 = Move(Geometry=boundary_surfaces_4, Motion=unit_y_2)  # -> Geometry, Transform
larger_than = LargerThan(FirstNumber=area.Area, SecondNumber=multiplication)  # -> LargerThan, OrEqualTo
unit_y_3 = UnitY(Factor=Slider(0.02, range=0..0.1))

list_length_2 = ListLength(List=extrude_along_2)
list_length_3 = ListLength(List=extrude_along)
multiplication_2 = Multiplication(A=list_length_3, B=length_4)
multiplication_3 = Multiplication(A=list_length_2, B=length_5)
addition_3 = Addition(A=multiplication_2, B=multiplication_3)
concatenate = Concatenate(FragmentA=addition_3, FragmentB="  M/L")
addition_4 = Addition(A=multiplication_2)
addition_5 = Addition(A=multiplication_3)
division_3 = Division(A=addition_5, B=6)
division_4 = Division(A=addition_4, B=6)
dowsil_895_structural_glazing_sealant = Panel(concatenate)
round = Round(Number=division_4)  # -> Nearest, Floor, Ceiling
round_2 = Round(Number=division_3)  # -> Nearest, Floor, Ceiling
area_2 = Area(Geometry=boundary_surfaces_4)  # -> Area, Centroid
context_print = ContextPrint(SilliconStructureFilling=dowsil_895_structural_glazing_sealant)
concatenate_2 = Concatenate(Fragment_A="6.00 m Bars = ", Fragment_B=round.Nearest, A=" Bars")
concatenate_3 = Concatenate(Fragment_A="6.00 m Bars = ", Fragment_B=round_2.Nearest, A=" Bars")
bars_for_mullions = Panel(concatenate_2)
bars_for_transoms = Panel(concatenate_3)
mass_addition = MassAddition(Input=area_2.Area)  # -> Result, PartialResults
area_3 = Data(mass_addition.Result)
concatenate_4 = Concatenate(FragmentA="Area = ", FragmentB=area_3)
panel = Panel(concatenate_4)
context_print_2 = ContextPrint(MullionProfileBarsToPurchase=bars_for_mullions)
context_print_3 = ContextPrint(TransomProfileBarsToPurchase=bars_for_transoms)
context_print_4 = ContextPrint(GlazingArea=panel)

extrude = Extrude(Base=move_2.Geometry, Direction=unit_y_3)
concatenate_5 = Concatenate(C=list_length, Fragment_A="  panels with size = ", B=dimensions.UDimension, Fragment_B="X", A=dimensions.VDimension)
concatenate_6 = Concatenate(
    C=list_length,
    Fragment_A="  panels with size = ",
    B=dimensions.UDimension,
    Fragment_B="X",
    A=dimensions.VDimension,
    D="   warning panel size larger than standard")
custom_preview_2 = CustomPreview(Geometry=extrude, Material=ColourSwatch(SwatchColor=RGBA(54, 192, 227, 68)))
cap_holes = CapHoles(Brep=extrude)
glass_panels = Data(flatten(cap_holes))
mullions_g = Data(flatten(extrude_along))
transoms = Data(flatten(extrude_along_2))
stream_filter = StreamFilter(Gate=larger_than.LargerThan, Stream0=concatenate_5, Stream1=concatenate_6)

walls = Data()
slabs = Data()
mesh = Mesh(slabs)
mesh_2 = Mesh(walls)
mesh_3 = Mesh()
mesh_4 = Mesh(glass_panels)
deconstruct_mesh = DeconstructMesh(Mesh=mesh)  # -> Vertices, Faces, Colours, Normals
deconstruct_mesh_2 = DeconstructMesh(Mesh=mesh_2)  # -> Vertices, Faces, Colours, Normals
deconstruct_mesh_3 = DeconstructMesh(Mesh=mesh_3)  # -> Vertices, Faces, Colours, Normals
deconstruct_mesh_4 = DeconstructMesh(Mesh=mesh_4)  # -> Vertices, Faces, Colours, Normals
colour = GetString(ColourSwatch(SwatchColor=RGBA(39, 158, 217, 137)), AtLeast=1, AtMost=1, TreeAccess=False)
construct_mesh = ConstructMesh(Vertices=deconstruct_mesh.Vertices, Faces=deconstruct_mesh.Faces, Colours=ColourSwatch(SwatchColor=RGB(0, 0, 0)))
construct_mesh_2 = ConstructMesh(
    Vertices=deconstruct_mesh_2.Vertices,
    Faces=deconstruct_mesh_2.Faces,
    Colours=ColourSwatch(SwatchColor=RGB(122, 122, 122)))
construct_mesh_3 = ConstructMesh(Vertices=deconstruct_mesh_3.Vertices, Faces=deconstruct_mesh_3.Faces)
construct_mesh_4 = ConstructMesh(Vertices=deconstruct_mesh_4.Vertices, Faces=deconstruct_mesh_4.Faces, Colours=colour)

panel_2 = Panel(stream_filter)
context_print_5 = ContextPrint(PanelsNumberAndSize=stream_filter)

context_bake = ContextBake(GlazingPanels=construct_mesh_4)
context_bake_2 = ContextBake(Geometry=transoms)
context_bake_3 = ContextBake(Geometry=mullions_g)

# ----
# Warning profile with long depth and high inertia needed ( not recommended)
wind_pressure_kg_sqm = Slider(69, range=50..90)
multiplication_4 = Multiplication(A=division, B=100)
multiplication_5 = Multiplication(A=fixing_height, B=100)
expression = Expression(Q=wind_pressure_kg_sqm, H=multiplication_5, i=multiplication_4, Expression="(((Q/10000)*i)*H^4)/(700000*H*(1/300))")
multiplication_6 = Multiplication(A="0.013", B=expression)
panel_4 = Panel(multiplication_6)
larger_than_2 = LargerThan(FirstNumber=multiplication_6, SecondNumber=Slider(600, range=0..1000))  # -> LargerThan, OrEqualTo
concatenate_7 = Concatenate(Fragment_A="profile with inertia", Fragment_B="=", A=panel_4, B=" cm4 needed")

concatenate_8 = Concatenate(
    Fragment_A="profile with inertia",
    Fragment_B="=",
    A=panel_4,
    B=" cm4 needed",
    C="   Warning fixing height is too large not recommended")

stream_filter_2 = StreamFilter(Gate=larger_than_2.LargerThan, Stream0=concatenate_7, Stream1=concatenate_8)
panel_5 = Panel(concatenate_8)
panel_6 = Panel(stream_filter_2)

context_print_6 = ContextPrint(RecommendedProfileInertia=stream_filter_2)
